# Grasshopper definition BrepToMesh_WithinBlocks.gh (Grasshopper 1.0.8)

m_objects = QueryModelObjects(Locked=True, Hidden=True, AutoUpdateState=True)
block_definition = ModelBlockDefinition(BlockDefinition=m_objects)  # -> BlockDefinition, Objects, Name
equals = EqualityFilter(Value="Curve")  # -> Equal, Unequal
filter = FilterContent(Content=block_definition.Objects, Filter=equals.Unequal)  # -> simplify(Content)
filter_2 = FilterContent(Content=block_definition.Objects, Filter=equals.Equal)  # -> simplify(Content)
object = ModelObject(Object=filter)  # -> Object, Geometry, Layer
debrep = DeconstructBrep(Brep=object.Geometry)  # -> Faces, Edges, Vertices
graft = GraftTree(Tree=object.Layer, IncludeEmptyLists=True, IncludeNullItems=True)
mesh = MeshBrep(
    Brep=debrep.Faces,
    Settings={GridMaxCount=0, GridMinCount=16, JaggedSeams=False, MaxEdgeLength=0, MinEdgeLength=0.0001, MinTolerance=0, Refine=True, RefineAngle=0, RelativeTolerance=0.65, SimplePlanes=True, Tolerance=0})
object_2 = ModelObject(Geometry=mesh, Layer=graft)
reduce_branches = CSharpScript(source=object_2)  # -> out, output; inputs source: tree
# ---------- reduce_branches: C# ----------
// Grasshopper Script Instance
#region Usings
using System;
using System.Linq;
using System.Collections;
using System.Collections.Generic;
using System.Drawing;

using Rhino;
using Rhino.Geometry;
using GH_IO.Types;

using Grasshopper;
using Grasshopper.Kernel;
using Grasshopper.Kernel.Data;
using Grasshopper.Kernel.Types;

#endregion

public class Script_Instance : GH_ScriptInstance
{
    #region Notes
    /* 
      Members:
        RhinoDoc RhinoDocument
        GH_Document GrasshopperDocument
        IGH_Component Component
        int Iteration

      Methods (Virtual & overridable):
        Print(string text)
        Print(string format, params object[] args)
        Reflect(object obj)
        Reflect(object obj, string method_name)
    */
    #endregion

    private void RunScript(DataTree<object> source, ref object output)
    {
        DataTree<object> newTree = new DataTree<object>();

        // Diccionario para agrupar elementos por rama principal
        Dictionary<int, List<object>> grouped = new Dictionary<int, List<object>>();

        foreach (var path in source.Paths)
        {
            int mainBranch = path.Indices[0]; // Tomamos el primer índice de la rama principal

            if (!grouped.ContainsKey(mainBranch))
                grouped[mainBranch] = new List<object>();

            grouped[mainBranch].AddRange(source.Branch(path));
        }

        // Añadimos cada grupo al DataTree con la rama colapsada
        foreach(var kvp in grouped)
        {
            newTree.AddRange(kvp.Value, new GH_Path(kvp.Key));
        }

        output = newTree;
    }
}
# ---------- end reduce_branches ----------
clean = CleanTree(RemoveNulls=True, RemoveInvalid=True, RemoveEmpty=False, Tree=reduce_branches.output)
merge = Merge(Data1=clean, Data2=filter_2)
block_definition_2 = ModelBlockDefinition(BlockDefinition=graft(block_definition.BlockDefinition), Objects=clean)  # -> BlockDefinition, Objects, Name
block_instance = ModelBlockInstance(BlockInstance=graft(m_objects), BlockDefinition=block_definition_2.BlockDefinition)  # -> BlockInstance, Transform, BlockDefinition
cache = ContentCache(Content=block_instance.BlockInstance)
